% Simulink data dictionary Off_Grid_Inverter_Control_LC.sldd

SharedConfig = Simulink.ConfigSet(StartTime="0", StopTime="10", RelTol="1e-3", Solver="VariableStepAuto", ProdHWDeviceType="Intel->x86-64 (Windows64)", SystemTargetFile="grt.tlc", TargetLang="C")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
Ic_abc = Simulink.Signal(StorageClass="SimulinkGlobal", DataType="single", Dimensions=3)
Ec_abc_Line = Simulink.Signal(StorageClass="SimulinkGlobal", DataType="single", Dimensions=3)
Udc = Simulink.Signal(StorageClass="SimulinkGlobal", DataType="single")
Mabc = Simulink.Signal(StorageClass="SimulinkGlobal", DataType="single", Dimensions=3)
PQ_Ref = Simulink.Signal(StorageClass="SimulinkGlobal", DataType="single", Dimensions=2)
Ic_ABC = Simulink.Signal(StorageClass="SimulinkGlobal", DataType="single", Dimensions=3)
Ec_ABC_Line = Simulink.Signal(StorageClass="SimulinkGlobal", DataType="single", Dimensions=3)
Ec_ABC_Phase = Simulink.Signal(StorageClass="SimulinkGlobal", DataType="single", Dimensions=3)
PQ_REF = Simulink.Signal(StorageClass="SimulinkGlobal", DataType="single", Dimensions=2)
Ec_ABC_p = Simulink.Signal(StorageClass="SimulinkGlobal", DataType="single", Dimensions=3)
Ec_ABC_n = Simulink.Signal(StorageClass="SimulinkGlobal", DataType="single", Dimensions=3)
Ic_ABC_n = Simulink.Signal(StorageClass="SimulinkGlobal", DataType="single", Dimensions=3)
Ic_ABC_p = Simulink.Signal(StorageClass="SimulinkGlobal", DataType="single", Dimensions=3)
wt = Simulink.Signal(StorageClass="SimulinkGlobal", DataType="single")
Ec_dq_p = Simulink.Signal(StorageClass="SimulinkGlobal", DataType="single", Dimensions=2)
Ec_dq_n = Simulink.Signal(StorageClass="SimulinkGlobal", DataType="single", Dimensions=2)
Ic_dq_p = Simulink.Signal(StorageClass="SimulinkGlobal", DataType="single", Dimensions=2)
Ic_dq_n = Simulink.Signal(StorageClass="SimulinkGlobal", DataType="single", Dimensions=2)
Ic_dq_p_ref = Simulink.Signal(StorageClass="SimulinkGlobal", DataType="single", Dimensions=2)
Ic_dq_n_ref = Simulink.Signal(StorageClass="SimulinkGlobal", DataType="single", Dimensions=2)
UDC = Simulink.Signal(StorageClass="SimulinkGlobal", DataType="single")
Uc_dq_p = Simulink.Signal(StorageClass="SimulinkGlobal", DataType="single", Dimensions=2)
Uc_dq_n = Simulink.Signal(StorageClass="SimulinkGlobal", DataType="single", Dimensions=2)
Negetive_wt = Simulink.Signal(StorageClass="SimulinkGlobal", DataType="single")
Reset = Simulink.Signal(DataType="boolean")
IL_ABC = Simulink.Signal(StorageClass="SimulinkGlobal", DataType="single", Dimensions=3)
IL_abc = Simulink.Signal(StorageClass="SimulinkGlobal", DataType="single", Dimensions=3)
IL_ABC_n = Simulink.Signal(StorageClass="SimulinkGlobal", DataType="single", Dimensions=3)
IL_ABC_p = Simulink.Signal(StorageClass="SimulinkGlobal", DataType="single", Dimensions=3)
IL_dq_p = Simulink.Signal(StorageClass="SimulinkGlobal", DataType="single", Dimensions=2)
IL_dq_n = Simulink.Signal(StorageClass="SimulinkGlobal", DataType="single", Dimensions=2)
IL_dq_n_ref = Simulink.Signal(StorageClass="SimulinkGlobal", DataType="single", Dimensions=2)
time = Simulink.Signal(DataType="single")
Uc_dq_p_ref = Simulink.Signal(DataType="single", Dimensions=2)
IL_dq_p_ref = Simulink.Signal(DataType="single", Dimensions=2)
Uc_dq_n_ref = Simulink.Signal(DataType="single", Dimensions=2)
Ec_abc_Phase = Simulink.Signal(DataType="single", Dimensions=3)
If_ABC = Simulink.Signal(Dimensions=3)
If_abc = Simulink.Signal(Dimensions=3)
If_dq = Simulink.Signal(Dimensions=2)