% Simulink data dictionary VariablesDictionary_for_PQ_Control_LCL.sldd

SharedConfig = Simulink.ConfigSet(StartTime="0", StopTime="10", RelTol="1e-3", Solver="VariableStepAuto", ProdHWDeviceType="Intel->x86-64 (Windows64)", SystemTargetFile="grt.tlc", TargetLang="C")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
Ic_abc = Simulink.Signal(StorageClass="SimulinkGlobal", DataType="single", Dimensions=3)
Ec_abc_Line = Simulink.Signal(StorageClass="SimulinkGlobal", DataType="single", Dimensions=3)
Udc = Simulink.Signal(StorageClass="SimulinkGlobal", DataType="single")
Mabc = Simulink.Signal(StorageClass="SimulinkGlobal", DataType="single", Dimensions=3)
PQ_Ref = Simulink.Signal(StorageClass="SimulinkGlobal", DataType="single", Dimensions=2)
Ic_ABC = Simulink.Signal(StorageClass="SimulinkGlobal", DataType="single", Dimensions=3)
Ec_ABC_Line = Simulink.Signal(StorageClass="SimulinkGlobal", DataType="single", Dimensions=3)
Ec_ABC_Phase = Simulink.Signal(StorageClass="SimulinkGlobal", DataType="single", Dimensions=3)
PQ_REF = Simulink.Signal(StorageClass="SimulinkGlobal", DataType="single", Dimensions=2)
Ec_ABC_p = Simulink.Signal(StorageClass="SimulinkGlobal", DataType="single", Dimensions=3)
Ec_ABC_n = Simulink.Signal(StorageClass="SimulinkGlobal", DataType="single", Dimensions=3)
Ic_ABC_n = Simulink.Signal(StorageClass="SimulinkGlobal", DataType="single", Dimensions=3)
Ic_ABC_p = Simulink.Signal(StorageClass="SimulinkGlobal", DataType="single", Dimensions=3)
wt = Simulink.Signal(StorageClass="SimulinkGlobal", DataType="single")
Ec_dq_p = Simulink.Signal(StorageClass="SimulinkGlobal", DataType="single", Dimensions=2)
Ec_dq_n = Simulink.Signal(StorageClass="SimulinkGlobal", DataType="single", Dimensions=2)
Ic_dq_p = Simulink.Signal(StorageClass="SimulinkGlobal", DataType="single", Dimensions=2)
Ic_dq_n = Simulink.Signal(StorageClass="SimulinkGlobal", DataType="single", Dimensions=2)
Ic_dq_p_ref = Simulink.Signal(StorageClass="SimulinkGlobal", DataType="single", Dimensions=2)
Ic_dq_n_ref = Simulink.Signal(StorageClass="SimulinkGlobal", DataType="single", Dimensions=2)
UDC = Simulink.Signal(StorageClass="SimulinkGlobal", DataType="single")
Uc_dq_p = Simulink.Signal(StorageClass="SimulinkGlobal", DataType="single", Dimensions=2)
Uc_dq_n = Simulink.Signal(StorageClass="SimulinkGlobal", DataType="single", Dimensions=2)
Negetive_wt = Simulink.Signal(StorageClass="SimulinkGlobal", DataType="single")
If_abc = Simulink.Signal(StorageClass="SimulinkGlobal", DataType="single")
If_ABC = Simulink.Signal(StorageClass="SimulinkGlobal", DataType="single")
If_dq = Simulink.Signal(StorageClass="SimulinkGlobal", DataType="single")
Reset = Simulink.Signal(StorageClass="SimulinkGlobal", DataType="boolean")
Modulation = Simulink.Parameter(1, DataType="uint16")
Gain_for_ActiveDamping = Simulink.Parameter(0.8, StorageClass="SimulinkGlobal", DataType="single", Min=0)
Wz_compensation = Simulink.Parameter(314.1592, DataType="single", Min=0)
Wp_compensation = Simulink.Parameter(148.99, DataType="single", Min=0)