% Simulink data dictionary VariablesDictionary_for_PQ_Control_LCL_4Legs.sldd

SharedConfig = Simulink.ConfigSet(StartTime="0", StopTime="10", RelTol="1e-3", Solver="VariableStepAuto", ProdHWDeviceType="Intel->x86-64 (Windows64)", SystemTargetFile="grt.tlc", TargetLang="C")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
Ic_abc = Simulink.Signal(StorageClass="SimulinkGlobal", DataType="single", Dimensions=3)
Ec_abc_Line = Simulink.Signal(StorageClass="SimulinkGlobal", DataType="single", Dimensions=3)
Mabc = Simulink.Signal(StorageClass="SimulinkGlobal", DataType="single", Dimensions=3)
PQ_Ref = Simulink.Signal(StorageClass="SimulinkGlobal", DataType="single", Dimensions=2)
Ic_ABC = Simulink.Signal(StorageClass="SimulinkGlobal", DataType="single", Dimensions=3)
Ec_ABC_Line = Simulink.Signal(StorageClass="SimulinkGlobal", DataType="single", Dimensions=3)
Ec_ABC_Phase = Simulink.Signal(StorageClass="SimulinkGlobal", DataType="single", Dimensions=3)
PQ_REF = Simulink.Signal(StorageClass="SimulinkGlobal", DataType="single", Dimensions=2)
Ec_ABC_p = Simulink.Signal(StorageClass="SimulinkGlobal", DataType="single", Dimensions=3)
Ec_ABC_n = Simulink.Signal(StorageClass="SimulinkGlobal", DataType="single", Dimensions=3)
Ic_ABC_n = Simulink.Signal(StorageClass="SimulinkGlobal", DataType="single", Dimensions=3)
Ic_ABC_p = Simulink.Signal(StorageClass="SimulinkGlobal", DataType="single", Dimensions=3)
wt = Simulink.Signal(StorageClass="SimulinkGlobal", DataType="single")
Ec_dq_p = Simulink.Signal(StorageClass="SimulinkGlobal", DataType="single", Dimensions=2)
Ec_dq_n = Simulink.Signal(StorageClass="SimulinkGlobal", DataType="single", Dimensions=2)
Ic_dq_p = Simulink.Signal(StorageClass="SimulinkGlobal", DataType="single", Dimensions=2)
Ic_dq_n = Simulink.Signal(StorageClass="SimulinkGlobal", DataType="single", Dimensions=2)
Ic_dq_p_ref = Simulink.Signal(StorageClass="SimulinkGlobal", DataType="single", Dimensions=2)
Ic_dq_n_ref = Simulink.Signal(StorageClass="SimulinkGlobal", DataType="single", Dimensions=2)
Uc_dq_p = Simulink.Signal(StorageClass="SimulinkGlobal", DataType="single", Dimensions=2)
Uc_dq_n = Simulink.Signal(StorageClass="SimulinkGlobal", DataType="single", Dimensions=2)
Negetive_wt = Simulink.Signal(StorageClass="SimulinkGlobal", DataType="single")
Reset = Simulink.Signal(DataType="boolean")
Udc = Simulink.Signal(StorageClass="SimulinkGlobal", DataType="single", Dimensions=2)
If_abc = Simulink.Signal(DataType="single", Dimensions=3)
UDC = Simulink.Signal(StorageClass="SimulinkGlobal", DataType="single", Dimensions=2)
If_ABC = Simulink.Signal(DataType="single", Dimensions=3)
I_neutral = Simulink.Signal(DataType="single", Dimensions=2)
If_dq = Simulink.Signal(DataType="single", Dimensions=2)